# Grasshopper definition 02.gh (Grasshopper 1.0.7)
# plug-ins: NGon

# ---- group: create boundary
number_slider = Slider(9, range=0..10)
box = CenterBox(Base=PlaneXY(0, 0, 0), X=Slider(20, range=0..100), Y=Slider(60, range=0..100), Z=Slider(30, range=0..100))
pop3d = Populate3D(Region=box, Count=Slider(500, range=0..2000), Seed=Slider(5736, range=0..10000))
pop3d_2 = Populate3D(Region=box, Count=Slider(12, range=0..100), Seed=1)

# ---- group: generate force
pln = Plane(pop3d_2)
deplane = DeconstructPlane(Plane=pln)  # -> Origin, XAxis, YAxis, ZAxis
lng = ListLength(List=pln)
series = Series(Start=Slider(5, range=0..10), Step=Slider(122, range=20..180), Count=lng)
rotate = Rotate(Geometry=pln, Angle=degrees(series), Plane=deplane.Origin)  # -> Geometry, Transform
deplane_2 = DeconstructPlane(Plane=rotate.Geometry)  # -> Origin, XAxis, YAxis, ZAxis
xz = XZPlane(Origin=deplane_2.Origin)
rotate_2 = Rotate(Geometry=rotate.Geometry, Angle=degrees(series), Plane=xz)  # -> Geometry, Transform
deplane_3 = DeconstructPlane(Plane=rotate_2.Geometry)  # -> Origin, XAxis, YAxis, ZAxis
yz = YZPlane(Origin=deplane_3.Origin)
rotate_3 = Rotate(Geometry=rotate_2.Geometry, Angle=degrees(series), Plane=yz)  # -> Geometry, Transform
dom = ConstructDomain(DomainStart=Slider(5, range=0..10), DomainEnd=Slider(30, range=0..100))
lng_2 = ListLength(List=rotate_3.Geometry)
random = Random(Range=dom, Number=lng_2, Seed=Slider(30, range=0..1000))
fspin = SpinForce(Plane=rotate_3.Geometry, Strength=Slider(2, range=0..10), Radius=random, Decay=Slider(5, range=0..10))
mergef = MergeFields(Fields=fspin)
fline = FieldLine(Field=mergef, Point=pop3d, Steps=1000, Accuracy=0.1, Method=3)

# ---- group: visualization
meshpipe = MeshPipe(Curve=fline, Radius=Slider(0.4, range=0..1), Sides=Slider(3, range=0..10), Tolerance=10, Ending=0)
meshpipe_2 = MeshPipe(Curve=fline, Radius=Slider(0.5, range=0..1), Sides=Slider(4, range=0..10), Tolerance=10, Ending=0)
cull = CullPattern(List=meshpipe, CullPattern=[False, True])
cull_2 = CullPattern(List=meshpipe, CullPattern=[True, False])
mjoin = MeshJoin(Meshes=meshpipe_2)
mjoin_2 = MeshJoin(Meshes=cull)
mjoin_3 = MeshJoin(Meshes=cull_2)
