# Grasshopper definition 03.gh (Grasshopper 1.0.7)

# ---- group: create geometry
number_slider = Slider(4000, range=0..10000)
sph = Sphere(Base=PlaneXY(0, 0, 0), Radius=Slider(100, range=0..100))
random = Random(Range=Domain(0, 1), Number=number_slider, Seed=2)
popgeo = PopulateGeometry(Geometry=sph, Count=number_slider, Seed=1)

# ---- group: random gradient point
pdecon = Deconstruct(Point=popgeo)  # -> XComponent, YComponent, ZComponent
bnd = Bounds(Numbers=pdecon.ZComponent)
remap = RemapNumbers(Value=pdecon.ZComponent, Source=bnd, Target=Domain(0, 1))  # -> Mapped, Clipped
larger = LargerThan(FirstNumber=remap.Mapped, SecondNumber=random)  # -> LargerThan, OrEqualTo

# ---- group: visualization
cull = CullPattern(List=popgeo, CullPattern=larger.LargerThan)
box = CenterBox(Base=cull, X=Slider(3.52, range=0..10), Y=Slider(1, range=0..10), Z=Slider(9.87, range=0..10))
dispatch = Dispatch(List=box, DispatchPattern=[True, False])  # -> ListA, ListB
brep = Brep(dispatch.ListB)
volume = Volume(Geometry=brep)  # -> Volume, Centroid
yz = YZPlane(Origin=volume.Centroid)
rotate = Rotate(Geometry=brep, Angle=1.570796327, Plane=yz)  # -> Geometry, Transform
brep_2 = Brep(dispatch.ListA)
