# Grasshopper definition 04.gh (Grasshopper 1.0.7)

# ---- group: generate grid of points
construct_domain = ConstructDomain(DomainStart=Slider(0, range=0..100), DomainEnd=Slider(208, range=0..1000))
range = Range(Domain=construct_domain, Steps=Slider(5, range=0..10))
construct_point = ConstructPoint(XCoordinate=Slider(0, range=0..100), YCoordinate=0, ZCoordinate=0)
unit_y = UnitY(Factor=range)
unit_x = UnitX(Factor=range)
unit_z = UnitZ(Factor=range)
move = Move(Geometry=construct_point, Motion=unit_y)  # -> Geometry, Transform
move_2 = Move(Geometry=move.Geometry, Motion=graft(unit_x))  # -> Geometry, Transform
move_3 = Move(Geometry=move_2.Geometry, Motion=graft(unit_z))  # -> Geometry, Transform
point = Point(flatten(move_3.Geometry))

# ---- group: create force / input curve
curve = Curve(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)
curve_2 = Curve(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)

# ---- group: create force
point_on_curve = PointOnCurve(curve, parameter=0.435)
divide_curve = DivideCurve(Curve=curve_2, Count=Slider(2, range=0..10), Kinks=False)  # -> Points, Tangents, Parameters
plane_normal = PlaneNormal(Origin=point_on_curve, ZAxis=point_on_curve)
plane_normal_2 = PlaneNormal(Origin=divide_curve.Points, ZAxis=divide_curve.Tangents)
spin_force = SpinForce(Plane=plane_normal_2, Strength=Slider(2, range=-10..10), Radius=Slider(30, range=0..100), Decay=Slider(5, range=0..100))
spin_force_2 = SpinForce(Plane=plane_normal, Strength=Slider(2, range=-10..10), Radius=Slider(10, range=0..100), Decay=Slider(5, range=0..100))
merge_fields = MergeFields(Fields=flatten([spin_force, spin_force_2]))
field_line = FieldLine(Field=merge_fields, Point=point, Steps=Slider(5000, range=0..10000), Accuracy=0.1, Method=3)

# ---- group: visualization
curve_3 = Curve(flatten(field_line))
dispatch = Dispatch(List=curve_3, DispatchPattern=[True, False])  # -> ListA, ListB
curve_4 = Curve(dispatch.ListA)
curve_5 = Curve(dispatch.ListB)
pipe = Pipe(Curve=curve_5, Radius=Slider(0.5, range=0..1), Caps=0)
pipe_2 = Pipe(Curve=curve_4, Radius=Slider(0.8, range=0..1), Caps=0)
