# Grasshopper definition 05.gh (Grasshopper 1.0.7)
# plug-ins: LunchBox, Weaverbird

# ---- group: base surface
sph = Sphere(Base=PlaneXY(0, 0, 0), Radius=Slider(100, range=0..100))

# ---- group: dispact random pannels
number_slider = Slider(30, range=0..100)
squads = SkewedQuads(Surface=sph, UDivisions=number_slider, VDivisions=number_slider, TParameter=0)  # -> FullPanels, EdgePanels
debrep = DeconstructBrep(Brep=squads.FullPanels)  # -> Faces, Edges, Vertices
randomsplit = RandomSplitList(MasterList=flatten(debrep.Faces), Seed=Slider(273, range=0..1000), Split=0.5)  # -> ListA, ListB
randomsplit_2 = RandomSplitList(MasterList=randomsplit.ListA, Seed=2, Split=0.5)  # -> ListA, ListB
volume = Volume(Geometry=sph)  # -> Volume, Centroid
join = BrepJoin(Breps=randomsplit_2.ListA)  # -> Breps, Closed
join_2 = BrepJoin(Breps=randomsplit_2.ListB)  # -> Breps, Closed
join_3 = BrepJoin(Breps=randomsplit.ListB)  # -> Breps, Closed
area = Area(Geometry=join.Breps)  # -> Area, Centroid
area_2 = Area(Geometry=join_2.Breps)  # -> Area, Centroid
area_3 = Area(Geometry=join_3.Breps)  # -> Area, Centroid
vec2pt = Vector2Pt(PointA=volume.Centroid, PointB=area.Centroid, Unitize=False)  # -> Vector, Length
vec2pt_2 = Vector2Pt(PointA=volume.Centroid, PointB=area_2.Centroid, Unitize=False)  # -> Vector, Length
vec2pt_3 = Vector2Pt(PointA=volume.Centroid, PointB=area_3.Centroid, Unitize=False)  # -> Vector, Length
amp = Amplitude(Vector=vec2pt.Vector, Amplitude=Slider(46, range=0..100))
amp_2 = Amplitude(Vector=vec2pt_2.Vector, Amplitude=Slider(68, range=0..100))
amp_3 = Amplitude(Vector=vec2pt_3.Vector, Amplitude=Slider(39, range=0..100))
move = Move(Geometry=join.Breps, Motion=amp)  # -> Geometry, Transform
move_2 = Move(Geometry=join_2.Breps, Motion=amp_2)  # -> Geometry, Transform
move_3 = Move(Geometry=join_3.Breps, Motion=amp_3)  # -> Geometry, Transform

# ---- group: visualization
mesh = MeshBrep(
    Brep=[move.Geometry, move_2.Geometry, move_3.Geometry],
    Settings={GridMaxCount=0, GridMinCount=16, JaggedSeams=False, MaxEdgeLength=0, MinEdgeLength=0.0001, MinTolerance=0, Refine=True, RefineAngle=0, RelativeTolerance=0.65, SimplePlanes=True, Tolerance=0})
neg = Negative(Value=Slider(62, range=0..100))
wbthicken = WeaverbirdsMeshThicken(MeshCurves=mesh, Distance=neg, OffsetType=0)
randomsplit_3 = RandomSplitList(MasterList=flatten(wbthicken), Seed=Slider(48, range=0..100), Split=0.5)  # -> ListA, ListB
mjoin = MeshJoin(Meshes=flatten(randomsplit_3.ListA))
mjoin_2 = MeshJoin(Meshes=flatten(randomsplit_3.ListB))
number_slider_2 = Slider(1, range=0..1)
number_slider_3 = Slider(10, range=0..10)
msmooth = SmoothMesh(Mesh=mjoin_2, Strength=number_slider_2, SkipNaked=True, Iterations=number_slider_3)
msmooth_2 = SmoothMesh(Mesh=mjoin, Strength=number_slider_2, SkipNaked=True, Iterations=number_slider_3)
