# Grasshopper definition 06.gh (Grasshopper 1.0.7)

# ---- group: base geometry
number_slider = Slider(106, range=0..180)
quad_sphere = QuadSphere(Base=PlaneXY(0, 0, 0), Radius=Slider(1, range=0..10))
quad_sphere_2 = QuadSphere(Base=PlaneXY(0, 0, 0), Radius=Slider(3, range=0..10))
yz_plane = YZPlane(Origin=Point(0, 0, 0))
xz_plane = XZPlane(Origin=Point(0, 0, 0))
rotate = Rotate(Geometry=quad_sphere, Angle=degrees(Slider(16, range=0..180)), Plane=xz_plane)  # -> Geometry, Transform
rotate_2 = Rotate(Geometry=quad_sphere_2, Angle=degrees(number_slider), Plane=yz_plane)  # -> Geometry, Transform
xz_plane_2 = XZPlane(Origin=Point(0, 0, 0))
rotate_3 = Rotate(Geometry=rotate_2.Geometry, Angle=degrees(number_slider), Plane=xz_plane_2)  # -> Geometry, Transform
deconstruct_brep = DeconstructBrep(Brep=rotate_3.Geometry)  # -> Faces, Edges, Vertices
area = Area(Geometry=deconstruct_brep.Faces)  # -> Area, Centroid
deconstruct_brep_2 = DeconstructBrep(Brep=rotate.Geometry)  # -> Faces, Edges, Vertices
surface_closest_point = SurfaceClosestPoint(Point=area.Centroid, Surface=deconstruct_brep.Faces)  # -> Point, UVPoint, Distance

# ---- group: create a moving vector
evaluate_surface = EvaluateSurface(Surface=deconstruct_brep.Faces, Point=surface_closest_point.Point)  # -> Point, Normal, UDirection, VDirection, Frame
construct_domain = ConstructDomain(DomainStart=Slider(4, range=0..100), DomainEnd=Slider(4, range=0..100))
list_length = ListLength(List=evaluate_surface.Point)
random = Random(Range=construct_domain, Number=list_length, Seed=Slider(20, range=0..100))
amplitude = Amplitude(Vector=evaluate_surface.Normal, Amplitude=random)
move = Move(Geometry=deconstruct_brep.Faces, Motion=amplitude)  # -> Geometry, Transform

# ---- group: connecting point
number_slider_2 = Slider(30, range=0..100)
populate_geometry = PopulateGeometry(Geometry=move.Geometry, Count=number_slider_2, Seed=Slider(59, range=0..100))
populate_geometry_2 = PopulateGeometry(Geometry=deconstruct_brep_2.Faces, Count=number_slider_2, Seed=1)
line = Line(StartPoint=populate_geometry_2, EndPoint=populate_geometry)

# ----
pipe = Pipe(Curve=line, Radius=Slider(0.1, range=0..1), Caps=0)
preview = CustomPreview(
    Geometry=pipe,
    Material={diffuse=RGB(221, 160, 221), emission=RGB(66, 48, 66), shine=0.5, specular=RGB(255, 255, 255), transparency=0})
