# Grasshopper definition 08.gh (Grasshopper 1.0.7)
# plug-ins: Pufferfish

polygon = Polygon(Plane=PlaneXY(0, 0, 0), Radius=Slider(18, range=0..100), Segments=Slider(5, range=0..10), FilletRadius=0)  # -> Polygon, Length
dom = ConstructDomain(DomainStart=Slider(0, range=0..10), DomainEnd=Slider(58, range=0..100))
range = Range(Domain=dom, Steps=10)
Z = UnitZ(Factor=range)
move = Move(Geometry=polygon.Polygon, Motion=Z)  # -> Geometry, Transform
pcen = PolygonCenter(Polyline=move.Geometry)  # -> CenterV, CenterE, CenterA
bnd = Bounds(Numbers=range)
dom_2 = ConstructDomain(DomainStart=Slider(0.3, range=0..1), DomainEnd=Slider(0.9, range=0..1))
multiplication = Multiplication(A=Slider(1.9, range=0..10), B=range)
remap = RemapNumbers(Value=range, Source=bnd, Target=dom_2)  # -> Mapped, Clipped
pi = Pi(Factor=multiplication)
graph = GraphMapper(
    remap.Mapped,
    x0=0,
    x1=1,
    y0=0,
    y1=1,
    container_name="Sine",
    Equation_px=[0.576005578, 0.7895321846],
    Equation_py=[0.5917875767, 0.1619970202])
rotate = Rotate(Geometry=move.Geometry, Angle=degrees(pi), Plane=PlaneXY(0, 0, 0))  # -> Geometry, Transform
scale_nu = ScaleNU(Geometry=rotate.Geometry, Plane=PlaneXY(0, 0, 0), ScaleX=graph, ScaleY=graph, ScaleZ=1)  # -> Geometry, Transform
loft = Loft(
    Curves=scale_nu.Geometry,
    Options={Adjust=False, Closed=False, LoftEnds=0, LoftSimp=0, LoftType=0, Rebuild=10, Refit=0.01})
neg = Negative(Value=Slider(0.5, range=0..1))
offsrf = OffsetSurface(Surface=loft, Distance=neg, BothSides=0, CreateSolid=True)
cap = CapHoles(Brep=offsrf)
mesh = MeshBrep(
    Brep=cap,
    Settings={GridMaxCount=0, GridMinCount=16, JaggedSeams=False, MaxEdgeLength=0, MinEdgeLength=0.0001, MinTolerance=0, Refine=True, RefineAngle=0, RelativeTolerance=0.65, SimplePlanes=True, Tolerance=0})
